# Dynamo graph 00_Vistas de assembly.dyn (Dynamo 4.0.2.3852)
# Por assembly: crea vista de planta (HorizontalDetail) y corte transversal (DetailSectionA), renombra y asigna escala automatica (>2 m -> 1:50, si no 1:25). Idempotente.

procesar_todos_los_assemblies = BoolSelector(true)  # graph input
filtro_por_nombre_si_todos_false = StringInput("")  # graph input
recrear_vistas_existentes_borra = BoolSelector(false)  # "Recrear vistas existentes (borra y rehace)"; graph input
altura_del_corte_sobre_el = IntegerSlider(30, range=10..100 step 5)  # "Altura del corte sobre el assembly (cm)"; graph input
tipo_de_vista_para_cortes = StringInput("02_FORMAS")  # "Tipo de vista para cortes (simbolo)"; graph input
view_template_para_las_vistas = StringInput("")  # "View template para las vistas (vacio = ninguno)"; graph input
margen_del_crop_planta_y_cortes = IntegerSlider(30, range=0..30 step 1)  # "Margen del crop, planta y cortes (mm)"; graph input
familia_de_pedestal_para = StringInput("C-Pedestal")  # "Familia de pedestal para callouts"; graph input
escala_de_los_callouts_1_n = IntegerSlider(10, range=5..50 step 5)  # graph input
margen_del_callout_mm = IntegerSlider(15, range=5..50 step 1)  # graph input
py_crear_planta_corte_por = Python(IN[0]=procesar_todos_los_assemblies, IN[1]=filtro_por_nombre_si_todos_false, IN[2]=recrear_vistas_existentes_borra, IN[3]=altura_del_corte_sobre_el, IN[4]=tipo_de_vista_para_cortes, IN[5]=view_template_para_las_vistas, IN[6]=margen_del_crop_planta_y_cortes, IN[7]=familia_de_pedestal_para, IN[8]=escala_de_los_callouts_1_n, IN[9]=margen_del_callout_mm)  # "PY | Crear planta + corte por assembly"; PythonNet3
# ---------- py_crear_planta_corte_por.python (739 lines) ----------
# 00_Vistas de assembly - Planta + corte por assembly, escala automatica, Detail Level Fine
# Revit 2027 / Dynamo 4 / CPython3
# IN[0] = procesar todos los assemblies (bool)
# IN[1] = filtro por nombre si IN[0] es False (parcial, separado por comas)
# IN[2] = recrear vistas existentes (bool) - borra y vuelve a crear
# IN[3] = altura del plano de corte de la planta sobre el tope del assembly (cm)
# IN[4] = tipo de vista de detalle para los cortes (define el simbolo de corte;
#         vacio = tipo por defecto; si no existe en el proyecto, avisa y sigue)
# IN[5] = view template para todas las vistas (vacio = ninguno; si no existe, avisa)
# IN[6] = margen del crop de planta y cortes sobre el borde del assembly, en mm de papel
# IN[7] = familia de pedestal para el criterio de callouts (default C-Pedestal)
# IN[8] = escala de los callouts de pedestal (1:N)
# IN[9] = margen del callout de pedestal, en mm de papel del callout

import clr
clr.AddReference('RevitAPI')
clr.AddReference('RevitServices')
from Autodesk.Revit.DB import (FilteredElementCollector, AssemblyInstance,
                               AssemblyViewUtils, AssemblyDetailViewOrientation,
                               View, UnitUtils, UnitTypeId, XYZ, Element,
                               ElementTransformUtils, BuiltInParameter, BuiltInCategory,
                               ElementId, ViewFamilyType, ViewFamily, StorageType,
                               BoundingBoxXYZ, ViewDetailLevel, Options, Solid,
                               GeometryInstance, Plane, FamilyInstance, ViewSection)
from RevitServices.Persistence import DocumentManager
from RevitServices.Transactions import TransactionManager
from System.Collections.Generic import List

doc = DocumentManager.Instance.CurrentDBDocument

process_all = bool(IN[0])
filter_text = (IN[1] or '').strip()
recreate = bool(IN[2])
cut_margin = float(IN[3]) / 30.48  # cm -> pies
sec_type_text = (IN[4] or '').strip()
tpl_text = (IN[5] or '').strip()
crop_margin_mm = float(IN[6])
pedestal_fam = (IN[7] or '').strip() or 'C-Pedestal'
pedestal_fam_low = pedestal_fam.lower()
callout_scale = int(IN[8]) if IN[8] else 10
callout_margin_mm = float(IN[9]) if IN[9] else 15.0

log = []
SUFIJO_CORTE = ' - CORTE A'
SUFIJO_CORTE_B = ' - CORTE B'
# sufijo SOLO para el titulo mostrado en lamina de la planta (Title on Sheet),
# no para el nombre interno de la vista (View.Name sigue siendo el nombre del
# assembly - lo usan 01, 02, 03, 04, 06 y 07 para encontrar la vista por nombre;
# cambiar View.Name romperia esas busquedas). Mismo mecanismo que ya usa el
# titulo en lamina de los cortes ("{assembly} - CORTE {letra}").
SUFIJO_TITULO_PLANTA = ' - FORMAS'

def to_m(v):
    return UnitUtils.ConvertFromInternalUnits(v, UnitTypeId.Meters)

def elem_name(e):
    try:
        return e.Name
    except Exception:
        return Element.Name.__get__(e)

def set_name(e, name):
    try:
        e.Name = name
    except Exception:
        Element.Name.__set__(e, name)

# --- tipo de vista para los cortes (define el simbolo de corte en la planta) ---
sec_type = None
if sec_type_text:
    detail_types = [t for t in FilteredElementCollector(doc).OfClass(ViewFamilyType)
                    if t.ViewFamily in (ViewFamily.Detail, ViewFamily.Section)]
    low = sec_type_text.lower()
    for t in detail_types:
        if elem_name(t).lower() == low:
            sec_type = t
            break
    if sec_type is None:
        log.append('AVISO: no existe el tipo de vista {} (ni como Section ni como Detail View); los cortes quedan con el tipo por defecto.'.format(sec_type_text))
        log.append('Tipos disponibles en este proyecto: ' + ', '.join(sorted(elem_name(t) for t in detail_types)))

# --- view template unico para todas las vistas ---
templates = [t for t in FilteredElementCollector(doc).OfClass(View) if t.IsTemplate]
view_template = None
if not tpl_text:
    log.append('Sin view template (campo vacio). Templates cargados en el proyecto:')
    for t in sorted(templates, key=lambda t: elem_name(t)):
        log.append('  - ' + elem_name(t))
    if not templates:
        log.append('  (ninguno cargado en este proyecto)')
else:
    lowt = tpl_text.lower()
    for t in templates:
        if elem_name(t).lower() == lowt:
            view_template = t
            break
    if view_template is None:
        cands = [t for t in templates if lowt in elem_name(t).lower()]
        if len(cands) == 1:
            view_template = cands[0]
    if view_template is None:
        log.append('AVISO: no existe un view template que coincida con {}; las vistas quedan sin template.'.format(tpl_text))
        log.append('Templates cargados en el proyecto: ' + ', '.join(sorted(elem_name(t) for t in templates)))

# --- tipo de vista para los callouts de pedestal (debe ser ViewFamily.Detail) ---
vftype_detail = None
tipos_vft_detail = [t for t in FilteredElementCollector(doc).OfClass(ViewFamilyType)
                    if t.ViewFamily == ViewFamily.Detail]
if tipos_vft_detail:
    vftype_detail = sorted(tipos_vft_detail, key=lambda t: elem_name(t))[0]
else:
    log.append('AVISO: no hay ningun ViewFamilyType de tipo Detail en el proyecto; no se pueden crear callouts de pedestal.')

# --- assemblies unicos por tipo ---
by_type = {}
for ai in FilteredElementCollector(doc).OfClass(AssemblyInstance):
    by_type.setdefault(ai.AssemblyTypeName, []).append(ai)

if process_all:
    targets = sorted(by_type.keys())
else:
    tokens = [t.strip().lower() for t in filter_text.split(',') if t.strip()]
    if tokens:
        targets = [n for n in sorted(by_type.keys())
                   if any(tok in n.lower() for tok in tokens)]
    else:
        targets = []
        log.append('ERROR: \"Procesar todos\" esta en False y el filtro esta vacio.')
    log.append('Filtro \"{}\": {} assemblies seleccionados.'.format(filter_text, len(targets)))

# vistas existentes por nombre (para idempotencia)
view_ids = {}
for v in FilteredElementCollector(doc).OfClass(View):
    if not v.IsTemplate:
        view_ids[elem_name(v)] = v.Id

def member_solid_bbox(el):
    # bounding box de el a partir de su geometria SOLIDA real (Volume > 0), en vez
    # de Element.get_BoundingBox() - que puede devolver un bbox "fantasma" (de
    # referencias/work planes) para elementos con geometria vacia o degenerada
    # (Volume=0), como paso con un C-Zapata con datos rotos (2026-07-13: bbox de
    # 3.7 m de alto para una zapata de 0.4x0.4 m, con Volume=0 y Area=0 - la
    # seccion se veia como un recuadro vacio y ademas inflaba la estimacion de
    # alto que usan 01/02 para armar la grilla de laminas). Devuelve None si el
    # elemento no tiene ningun solido valido (en vez de un bbox fantasma), asi
    # el llamador puede excluirlo del calculo y el log avisa cual assembly tiene
    # el problema. Maneja simbolos anidados (GeometryInstance), mismo patron que
    # collect_faces() en 03_Cotas generales.
    opt = Options()
    opt.DetailLevel = ViewDetailLevel.Fine
    try:
        geo = el.get_Geometry(opt)
    except Exception:
        geo = None
    if geo is None:
        return None
    minx = miny = minz = float('inf')
    maxx = maxy = maxz = float('-inf')
    hay = False
    def acumular(solid, trf):
        sbb = solid.GetBoundingBox()
        for x in (sbb.Min.X, sbb.Max.X):
            for y in (sbb.Min.Y, sbb.Max.Y):
                for z in (sbb.Min.Z, sbb.Max.Z):
                    p = sbb.Transform.OfPoint(XYZ(x, y, z))
                    if trf is not None:
                        p = trf.OfPoint(p)
                    yield p
    pts = []
    for g in geo:
        if isinstance(g, Solid) and g.Volume > 1e-9:
            pts.extend(list(acumular(g, None)))
        elif isinstance(g, GeometryInstance):
            for sg in g.GetSymbolGeometry():
                if isinstance(sg, Solid) and sg.Volume > 1e-9:
                    pts.extend(list(acumular(sg, g.Transform)))
    for p in pts:
        hay = True
        if p.X < minx: minx = p.X
        if p.X > maxx: maxx = p.X
        if p.Y < miny: miny = p.Y
        if p.Y > maxy: maxy = p.Y
        if p.Z < minz: minz = p.Z
        if p.Z > maxz: maxz = p.Z
    if not hay:
        return None
    class _BB(object):
        pass
    r = _BB()
    r.Min = XYZ(minx, miny, minz)
    r.Max = XYZ(maxx, maxy, maxz)
    return r

def local_size(ai):
    # bbox de los miembros en coordenadas locales del assembly, en metros
    t = ai.GetTransform()
    tinv = t.Inverse
    mins = [float('inf')] * 3
    maxs = [float('-inf')] * 3
    for mid in ai.GetMemberIds():
        el = doc.GetElement(mid)
        bb = member_solid_bbox(el)
        if bb is None:
            continue
        for x in (bb.Min.X, bb.Max.X):
            for y in (bb.Min.Y, bb.Max.Y):
                for z in (bb.Min.Z, bb.Max.Z):
                    p = tinv.OfPoint(XYZ(x, y, z))
                    vals = (p.X, p.Y, p.Z)
                    for i in range(3):
                        if vals[i] < mins[i]:
                            mins[i] = vals[i]
                        if vals[i] > maxs[i]:
                            maxs[i] = vals[i]
    if mins[0] == float('inf'):
        return None
    return [to_m(maxs[i] - mins[i]) for i in range(3)]

def world_z_range(ai):
    zmin = float('inf')
    zmax = float('-inf')
    for mid in ai.GetMemberIds():
        el = doc.GetElement(mid)
        bb = member_solid_bbox(el)
        if bb is None:
            continue
        if bb.Min.Z < zmin:
            zmin = bb.Min.Z
        if bb.Max.Z > zmax:
            zmax = bb.Max.Z
    if zmin > zmax:
        return None
    return (zmin, zmax)

def find_viewer(vname):
    # marcador de la vista (categoria Views/Viewers), comparte nombre con la vista
    for ve in FilteredElementCollector(doc).OfCategory(BuiltInCategory.OST_Viewers):
        if elem_name(ve) == vname:
            return ve
    return None

def orientar_burbuja_corte(v, tname, label):
    # la burbuja (circulo con la letra) del simbolo de corte debe quedar del
    # lado norte (arriba en la lamina); el otro extremo de la linea (flecha
    # verde) queda entonces al sur (abajo). La linea de corte en planta es
    # PERPENDICULAR a la ViewDirection (la vista mira perpendicular a su
    # propia linea): un corte con linea vertical (norte-sur, el que tiene
    # lado arriba/abajo) tiene ViewDirection dominante en X; uno con linea
    # horizontal (ViewDirection dominante en Y) no tiene ese lado, se deja
    # como esta. Se logra espejando el marcador (categoria Views/Viewers)
    # respecto al plano horizontal que pasa por el centro del crop: es la
    # misma operacion que el control de flip de Revit al seleccionar la
    # linea de corte (tambien invierte la direccion de vista, por lo que el
    # corte queda mirado desde el lado opuesto).
    vd = v.ViewDirection
    if abs(vd.X) <= abs(vd.Y):
        return
    viewer = find_viewer(elem_name(v))
    if viewer is None:
        log.append('AVISO {}: no se encontro el marcador de {} para orientar la burbuja.'.format(tname, label))
        return
    cb = v.CropBox
    centro_local = XYZ((cb.Min.X + cb.Max.X) / 2.0, (cb.Min.Y + cb.Max.Y) / 2.0, (cb.Min.Z + cb.Max.Z) / 2.0)
    centro = cb.Transform.OfPoint(centro_local)
    try:
        marcador_y = viewer.Location.Point.Y
    except Exception:
        marcador_y = v.Origin.Y
    if marcador_y >= centro.Y:
        return  # la burbuja ya esta al norte (arriba)
    plano = Plane.CreateByNormalAndOrigin(XYZ(0.0, 1.0, 0.0), centro)
    # MirrorElements con mirrorCopies=False voltea el marcador ORIGINAL en su
    # lugar (equivalente al control de flip de Revit): la burbuja pasa al
    # extremo norte y el otro extremo queda como flecha. OJO: MirrorElement
    # (singular) NO sirve aca - siempre crea una COPIA espejada, que en un
    # viewer significa duplicar la vista de corte entera (bug visto el
    # 2026-07-13: aparecian cortes Detail View duplicados con burbuja en
    # ambos extremos).
    ids = List[ElementId]([viewer.Id])
    ElementTransformUtils.MirrorElements(doc, ids, plano, False)
    doc.Regenerate()
    log.append('{}: burbuja de {} pasada al lado norte (arriba en la lamina).'.format(tname, label))

def ajustar_corte_planta(vplan, ai, tname):
    # sube el plano de corte por encima del assembly (nada queda cortado,
    # todo se ve en proyeccion como una planta real) y extiende el far clip
    # para ver hasta abajo del assembly
    dirz = vplan.ViewDirection.Z
    if abs(dirz) < 0.99:
        log.append('AVISO {}: la planta no es una vista vertical, no se ajusta el corte.'.format(tname))
        return
    zr = world_z_range(ai)
    if zr is None:
        log.append('AVISO {}: sin geometria para ajustar el corte de la planta.'.format(tname))
        return
    zmin, zmax = zr
    if dirz > 0:
        objetivo = zmax + cut_margin
        far = (objetivo - zmin) + cut_margin
    else:
        objetivo = zmin - cut_margin
        far = (zmax - objetivo) + cut_margin
    dz = objetivo - vplan.Origin.Z
    if abs(dz) > 0.003:
        viewer = find_viewer(elem_name(vplan))
        if viewer is None:
            log.append('AVISO {}: no se encontro el marcador de la planta para mover el corte.'.format(tname))
            return
        ElementTransformUtils.MoveElement(doc, viewer.Id, XYZ(0.0, 0.0, dz))
        log.append('{}: plano de corte de la planta subido {:.2f} m sobre el tope del assembly.'.format(tname, to_m(cut_margin)))
    p = vplan.get_Parameter(BuiltInParameter.VIEWER_BOUND_OFFSET_FAR)
    if p is not None and not p.IsReadOnly:
        p.Set(far)

def ajustar_crop_planta(vplan, ai, tname):
    # recorta el crop de la planta justo al borde del assembly (+ margen).
    # Se trabaja en el sistema local del CropBox (su Transform), no en el del
    # assembly, para que quede correcto sin importar la orientacion de la vista.
    # El Annotation Crop se desactiva para que cotas/tags/leaders (que viven
    # fuera del borde del assembly) nunca queden cortados por este recorte.
    bb = vplan.CropBox
    inv = bb.Transform.Inverse
    minx = miny = float('inf')
    maxx = maxy = float('-inf')
    hay_geo = False
    for mid in ai.GetMemberIds():
        el = doc.GetElement(mid)
        mbb = member_solid_bbox(el)
        if mbb is None:
            continue
        hay_geo = True
        for x in (mbb.Min.X, mbb.Max.X):
            for y in (mbb.Min.Y, mbb.Max.Y):
                for z in (mbb.Min.Z, mbb.Max.Z):
                    p = inv.OfPoint(XYZ(x, y, z))
                    if p.X < minx:
                        minx = p.X
                    if p.X > maxx:
                        maxx = p.X
                    if p.Y < miny:
                        miny = p.Y
                    if p.Y > maxy:
                        maxy = p.Y
    if not hay_geo:
        log.append('AVISO {}: sin geometria para ajustar el crop de la planta.'.format(tname))
        return
    margen = crop_margin_mm / 304.8 * vplan.Scale
    nuevo = BoundingBoxXYZ()
    nuevo.Transform = bb.Transform
    nuevo.Min = XYZ(minx - margen, miny - margen, bb.Min.Z)
    nuevo.Max = XYZ(maxx + margen, maxy + margen, bb.Max.Z)
    vplan.CropBox = nuevo
    try:
        mgr = vplan.GetCropRegionShapeManager()
        mgr.IsAnnotationCropActive = False
    except Exception:
        pass
    log.append('{}: crop de planta ajustado al borde del assembly (+{:.0f} mm).'.format(tname, crop_margin_mm))

def ajustar_crop_corte(vsec, ai, tname, label):
    # recorta el crop de los cortes -ANCHO y ALTO, ejes propios del corte- al borde
    # del assembly; esto tambien acorta la linea de seccion dibujada en la planta,
    # que antes salia mucho mas larga que el assembly. Ajustar el ALTO (agregado
    # 2026-07-13) es seguro porque el Annotation Crop se desactiva mas abajo: la
    # cota de altura y la spot elevation superior de 03, que se colocan por fuera
    # de este crop, no quedan cortadas aunque el crop quede ceñido a la geometria.
    # Antes el alto quedaba en el default de Revit (mucho mayor que una zapata
    # chica), lo que inflaba la estimacion de View.CropBox que usan 01/02 para
    # armar la grilla de laminas: cada bloque parecia ocupar casi una lamina
    # entera y el packing abandonaba la fila/lamina casi vacia.
    # Igual que en la planta, se desactiva el Annotation Crop para no cortar
    # la cota de altura ni las spot elevations de 04, que quedan mas afuera.
    bb = vsec.CropBox
    inv = bb.Transform.Inverse
    minx = miny = float('inf')
    maxx = maxy = float('-inf')
    hay_geo = False
    for mid in ai.GetMemberIds():
        el = doc.GetElement(mid)
        mbb = member_solid_bbox(el)
        if mbb is None:
            continue
        hay_geo = True
        for x in (mbb.Min.X, mbb.Max.X):
            for y in (mbb.Min.Y, mbb.Max.Y):
                for z in (mbb.Min.Z, mbb.Max.Z):
                    p = inv.OfPoint(XYZ(x, y, z))
                    if p.X < minx:
                        minx = p.X
                    if p.X > maxx:
                        maxx = p.X
                    if p.Y < miny:
                        miny = p.Y
                    if p.Y > maxy:
                        maxy = p.Y
    if not hay_geo:
        log.append('AVISO {}: sin geometria para ajustar el crop de {}.'.format(tname, label))
        return
    margen = crop_margin_mm / 304.8 * vsec.Scale
    nuevo = BoundingBoxXYZ()
    nuevo.Transform = bb.Transform
    nuevo.Min = XYZ(minx - margen, miny - margen, bb.Min.Z)
    nuevo.Max = XYZ(maxx + margen, maxy + margen, bb.Max.Z)
    vsec.CropBox = nuevo
    try:
        mgr = vsec.GetCropRegionShapeManager()
        mgr.IsAnnotationCropActive = False
    except Exception:
        pass
    log.append('{}: crop de {} ajustado al assembly (+{:.0f} mm, ancho y alto).'.format(tname, label, crop_margin_mm))

def ajustar_titulo_planta(v, tname):
    # titulo en lamina = '{assembly} - FORMAS' via Title on Sheet, sin tocar el
    # nombre interno de la vista (ver SUFIJO_TITULO_PLANTA arriba).
    p = v.get_Parameter(BuiltInParameter.VIEW_DESCRIPTION)
    if p is None or p.IsReadOnly:
        return
    deseado = tname + SUFIJO_TITULO_PLANTA
    if p.AsString() != deseado:
        p.Set(deseado)

def ocultar_simbolos_corte(v):
    # los cortes salen limpios: sin simbolos de corte de otras vistas
    try:
        cat = ElementId(BuiltInCategory.OST_Sections)
        if v.CanCategoryBeHidden(cat):
            v.SetCategoryHidden(cat, True)
    except Exception:
        pass

PARAM_CANTIDAD = 'Cantidad_Inserto'
_param_avisado = [False]

def set_cantidad(v, cantidad, tname):
    # cantidad de assemblies de este tipo en el proyecto -> parametro del titulo
    p = v.LookupParameter(PARAM_CANTIDAD)
    if p is None:
        if not _param_avisado[0]:
            _param_avisado[0] = True
            log.append('AVISO: las vistas no tienen el parametro {} (agregarlo como parametro de proyecto en la categoria Views).'.format(PARAM_CANTIDAD))
        return
    if p.IsReadOnly:
        return
    st = p.StorageType
    if st == StorageType.Integer:
        p.Set(int(cantidad))
    elif st == StorageType.Double:
        p.Set(float(cantidad))
    else:
        p.Set(str(cantidad))
    log.append('{}: {} = {}.'.format(tname, PARAM_CANTIDAD, cantidad))

def aplicar_template(v, tname, label, scale):
    if view_template is None:
        return
    try:
        if v.ViewTemplateId != view_template.Id:
            v.ViewTemplateId = view_template.Id
            log.append('{}: template aplicado a {}.'.format(tname, label))
        try:
            # re-asegurar la escala automatica (si el template la controla, gana el template)
            if v.Scale != scale:
                v.Scale = scale
        except Exception:
            pass
    except Exception as e:
        log.append('ERROR {} aplicando template a {}: {}'.format(tname, label, e))

def instancias_recursivas(ai):
    # TODAS las FamilyInstance del assembly (contenedores y hojas, cualquier
    # profundidad de anidamiento) - igual patron que 99_Diagnostico pedestales.
    vistos = set()
    resultado = []
    stack = list(ai.GetMemberIds())
    while stack:
        eid = stack.pop()
        if eid.Value in vistos:
            continue
        vistos.add(eid.Value)
        el = doc.GetElement(eid)
        if el is None or not isinstance(el, FamilyInstance):
            continue
        resultado.append(el)
        try:
            stack.extend(list(el.GetSubComponentIds()))
        except Exception:
            pass
    return resultado

def tipos_pedestal(ai):
    # agrupa por TIPO (Symbol.Name) las instancias de la familia de pedestal
    # (IN[7], default C-Pedestal); con 0 o 1 tipo distinto no se crea ningun
    # callout - solo interesan los assemblies con 2 o mas tipos.
    grupos = {}
    for el in instancias_recursivas(ai):
        try:
            fam = el.Symbol.Family.Name
        except Exception:
            continue
        if fam.lower() != pedestal_fam_low:
            continue
        tn = elem_name(el.Symbol)
        grupos.setdefault(tn, []).append(el)
    return grupos

def bbox_con_anidados(el):
    # bbox solido de el INCLUYENDO sus sub-componentes anidados (recursivo).
    # Un C-Pedestal es un CONTENEDOR: su geometria real de hormigon vive en
    # familias anidadas mas profundas (ej. el G35 dentro del PD-1004), y
    # member_solid_bbox solo ve solidos propios y del primer nivel de
    # GeometryInstance - para el contenedor devuelve None (visto 2026-07-13:
    # todos los pedestales daban 'sin geometria valida' y ningun callout se
    # creaba). Los sub-componentes son FamilyInstance reales cuya geometria
    # ya viene en coordenadas de mundo, asi que basta unir sus bboxes.
    pila = [el]
    vistos = set()
    minx = miny = minz = float('inf')
    maxx = maxy = maxz = float('-inf')
    hay = False
    while pila:
        e = pila.pop()
        if e is None:
            continue
        try:
            eid = e.Id.Value
        except Exception:
            eid = None
        if eid is not None:
            if eid in vistos:
                continue
            vistos.add(eid)
        bb = member_solid_bbox(e)
        if bb is not None:
            hay = True
            if bb.Min.X < minx: minx = bb.Min.X
            if bb.Max.X > maxx: maxx = bb.Max.X
            if bb.Min.Y < miny: miny = bb.Min.Y
            if bb.Max.Y > maxy: maxy = bb.Max.Y
            if bb.Min.Z < minz: minz = bb.Min.Z
            if bb.Max.Z > maxz: maxz = bb.Max.Z
        if isinstance(e, FamilyInstance):
            try:
                for sid in e.GetSubComponentIds():
                    pila.append(doc.GetElement(sid))
            except Exception:
                pass
    if not hay:
        return None
    class _BB(object):
        pass
    r = _BB()
    r.Min = XYZ(minx, miny, minz)
    r.Max = XYZ(maxx, maxy, maxz)
    return r

def elemento_mas_a_la_derecha(vplan, instancias):
    # de las instancias de UN tipo, la que queda mas a la derecha en el
    # sistema LOCAL de la planta (coordenada X de su CropBox.Transform) - asi
    # el resultado es correcto sin importar la rotacion real del assembly.
    inv = vplan.CropBox.Transform.Inverse
    mejor = None
    mejor_x = float('-inf')
    for el in instancias:
        bb = bbox_con_anidados(el)
        if bb is None:
            continue
        cx = (bb.Min.X + bb.Max.X) / 2.0
        cy = (bb.Min.Y + bb.Max.Y) / 2.0
        cz = (bb.Min.Z + bb.Max.Z) / 2.0
        p_local = inv.OfPoint(XYZ(cx, cy, cz))
        if p_local.X > mejor_x:
            mejor_x = p_local.X
            mejor = (el, bb)
    return mejor

def crear_callout_pedestal(vplan, tname, tipo, bb, vftype, escala, margen_mm):
    # crea (o salta si ya existe) el callout de UN tipo de pedestal, alrededor
    # del pedestal elegido (bb = bounding box real en coordenadas de MUNDO,
    # de member_solid_bbox). Los puntos van en coordenadas de mundo (igual
    # tecnica que ajustar_crop_planta/ajustar_crop_corte: local via
    # CropBox.Transform.Inverse, expandir el margen, volver a mundo con
    # CropBox.Transform) - confirmado con un test reversible que CreateCallout
    # acepta puntos de mundo sobre una planta de assembly (Detail View).
    global callouts_creados, callouts_saltados
    inv = vplan.CropBox.Transform.Inverse
    tr = vplan.CropBox.Transform
    minx = miny = float('inf')
    maxx = maxy = float('-inf')
    for x in (bb.Min.X, bb.Max.X):
        for y in (bb.Min.Y, bb.Max.Y):
            for z in (bb.Min.Z, bb.Max.Z):
                p = inv.OfPoint(XYZ(x, y, z))
                if p.X < minx:
                    minx = p.X
                if p.X > maxx:
                    maxx = p.X
                if p.Y < miny:
                    miny = p.Y
                if p.Y > maxy:
                    maxy = p.Y
    margen = margen_mm / 304.8 * escala
    p1 = tr.OfPoint(XYZ(minx - margen, miny - margen, 0.0))
    p2 = tr.OfPoint(XYZ(maxx + margen, maxy + margen, 0.0))
    vname = '{} - PEDESTAL {}'.format(tname, tipo)
    if vname in view_ids:
        if recreate:
            doc.Delete(view_ids[vname])
            del view_ids[vname]
            log.append('{}: callout de {} anterior eliminado.'.format(tname, tipo))
        else:
            log.append('{}: callout de {} ya existe, se salta.'.format(tname, tipo))
            callouts_saltados += 1
            return
    callout = ViewSection.CreateCallout(doc, vplan.Id, vftype.Id, p1, p2)
    set_name(callout, vname)
    callout.Scale = escala
    callout.DetailLevel = ViewDetailLevel.Fine
    try:
        if callout.CropBoxVisible:
            callout.CropBoxVisible = False
    except Exception:
        pass
    view_ids[vname] = callout.Id
    callouts_creados += 1
    log.append('OK {}: callout de pedestal {} creado (\"{}\"), escala 1:{}.'.format(tname, tipo, vname, escala))

callouts_creados = 0
callouts_saltados = 0
created = 0
skipped = 0
TransactionManager.Instance.EnsureInTransaction(doc)
try:
    for tname in targets:
        insts = by_type[tname]
        ai = insts[0]
        if len(insts) > 1:
            log.append('AVISO {}: {} instancias del mismo tipo, se documenta la primera.'.format(tname, len(insts)))
        try:
            size = local_size(ai)
            scale = 50 if size is not None and (size[0] > 2.0 or size[1] > 2.0) else 25
            jobs = ((tname, AssemblyDetailViewOrientation.HorizontalDetail, 'planta'),
                    (tname + SUFIJO_CORTE, AssemblyDetailViewOrientation.DetailSectionA, 'corte A'),
                    (tname + SUFIJO_CORTE_B, AssemblyDetailViewOrientation.DetailSectionB, 'corte B'))
            vplan_obj = None
            for vname, orient, label in jobs:
                v_obj = None
                if vname in view_ids:
                    if recreate:
                        doc.Delete(view_ids[vname])
                        del view_ids[vname]
                        log.append('{}: {} anterior eliminada (tambien su viewport si estaba en un sheet).'.format(tname, label))
                    else:
                        log.append('{}: {} ya existe, se salta.'.format(tname, label))
                        skipped += 1
                        v_obj = doc.GetElement(view_ids[vname])
                if v_obj is None:
                    v_obj = AssemblyViewUtils.CreateDetailSection(doc, ai.Id, orient)
                    set_name(v_obj, vname)
                    v_obj.Scale = scale
                    v_obj.DetailLevel = ViewDetailLevel.Fine
                    view_ids[vname] = v_obj.Id
                    created += 1
                    log.append('OK {}: {} creada, escala 1:{}.'.format(tname, label, scale))
                if v_obj is not None:
                    try:
                        # "Crop View" (geometria) activo: sin esto la vista muestra
                        # su extension completa sin recortar, mucho mas grande que
                        # el CropBox que ajustan ajustar_crop_planta/ajustar_crop_corte
                        # mas abajo - desperdicia espacio en la grilla de 01/02 aunque
                        # el CropBox este bien calculado. Distinto del Annotation Crop
                        # (ese se desactiva a proposito para no cortar cotas/tags).
                        if not v_obj.CropBoxActive:
                            v_obj.CropBoxActive = True
                        # el RECTANGULO del crop no se dibuja (linea visible), pero
                        # el recorte de geometria (CropBoxActive) sigue activo arriba
                        if v_obj.CropBoxVisible:
                            v_obj.CropBoxVisible = False
                    except Exception as e:
                        log.append('ERROR {} activando Crop View: {}'.format(tname, e))
                    aplicar_template(v_obj, tname, label, scale)
                if label == 'planta' and v_obj is not None:
                    try:
                        ajustar_corte_planta(v_obj, ai, tname)
                    except Exception as e:
                        log.append('ERROR {} ajustando corte de planta: {}'.format(tname, e))
                    try:
                        ajustar_crop_planta(v_obj, ai, tname)
                    except Exception as e:
                        log.append('ERROR {} ajustando crop de planta: {}'.format(tname, e))
                    try:
                        ajustar_titulo_planta(v_obj, tname)
                    except Exception as e:
                        log.append('ERROR {} ajustando titulo de planta: {}'.format(tname, e))
                    try:
                        set_cantidad(v_obj, len(insts), tname)
                    except Exception as e:
                        log.append('ERROR {} seteando {}: {}'.format(tname, PARAM_CANTIDAD, e))
                    vplan_obj = v_obj
                elif v_obj is not None:
                    ocultar_simbolos_corte(v_obj)
                    try:
                        orientar_burbuja_corte(v_obj, tname, label)
                    except Exception as e:
                        log.append('ERROR {} orientando burbuja de {}: {}'.format(tname, label, e))
                    try:
                        ajustar_crop_corte(v_obj, ai, tname, label)
                    except Exception as e:
                        log.append('ERROR {} ajustando crop de {}: {}'.format(tname, label, e))
                    if sec_type is not None and v_obj.GetTypeId() != sec_type.Id:
                        try:
                            v_obj.ChangeTypeId(sec_type.Id)
                            log.append('{}: {} cambiado al tipo de vista {}.'.format(tname, label, sec_type_text))
                        except Exception as e:
                            log.append('ERROR {} cambiando el tipo de {}: {}'.format(tname, label, e))
            if vplan_obj is not None and vftype_detail is not None:
                try:
                    grupos = tipos_pedestal(ai)
                except Exception as e:
                    grupos = {}
                    log.append('ERROR {} agrupando pedestales: {}'.format(tname, e))
                if len(grupos) >= 2:
                    log.append('{}: {} tipos de {} -> se crean callouts (uno por tipo, el mas a la derecha).'.format(tname, len(grupos), pedestal_fam))
                    for tipo in sorted(grupos):
                        elegido = elemento_mas_a_la_derecha(vplan_obj, grupos[tipo])
                        if elegido is None:
                            log.append('AVISO {}: sin geometria valida para el pedestal tipo {}.'.format(tname, tipo))
                            continue
                        el_ped, bb_ped = elegido
                        try:
                            crear_callout_pedestal(vplan_obj, tname, tipo, bb_ped, vftype_detail, callout_scale, callout_margin_mm)
                        except Exception as e:
                            log.append('ERROR {} creando callout de {}: {}'.format(tname, tipo, e))
        except Exception as e:
            log.append('ERROR {}: {}'.format(tname, e))
finally:
    TransactionManager.Instance.TransactionTaskDone()

log.insert(0, 'Assemblies procesados: {} | vistas creadas: {} | saltadas: {} | callouts creados: {} | callouts saltados: {}'.format(len(targets), created, skipped, callouts_creados, callouts_saltados))
OUT = log
# ----------------------------------------
log = Watch(py_crear_planta_corte_por)  # graph output
