# Dynamo graph 03_Ejes y cotas entre ejes.dyn (Dynamo 4.0.2.3852)
# Por assembly: enciende los ejes en plantas y elevaciones, dibuja el eje de cada viga en planta como linea L-CENTER y acota entre ejes estructurales en las plantas.

procesar_todos_los_assemblies = BoolSelector(true)  # graph input
filtro_por_nombre_si_todos_false = StringInput("")  # graph input
separacion_de_la_cadena_al_borde = IntegerSlider(20, range=0..100 step 1)  # "Separacion de la cadena al borde del assembly (mm)"; graph input
cadena_horizontal_arriba_de_la = BoolSelector(true)  # "Cadena horizontal (arriba de la planta)"; graph input
cadena_vertical_izquierda_de_la = BoolSelector(true)  # "Cadena vertical (izquierda de la planta)"; graph input
mostrar_ejes_tambien_en_las = BoolSelector(true)  # "Mostrar ejes tambien en las elevaciones"; graph input
eje_de_vigas_dibujar_en_las = BoolSelector(true)  # "Eje de vigas: dibujar en las plantas"; graph input
eje_de_vigas_estilo_de_linea = StringInput("L-CENTER")  # graph input
eje_de_vigas_redibujar_los = BoolSelector(false)  # "Eje de vigas: redibujar los existentes"; graph input
py_ejes_visibles_eje_de_vigas = Python(IN[0]=procesar_todos_los_assemblies, IN[1]=filtro_por_nombre_si_todos_false, IN[2]=separacion_de_la_cadena_al_borde, IN[3]=cadena_horizontal_arriba_de_la, IN[4]=cadena_vertical_izquierda_de_la, IN[5]=mostrar_ejes_tambien_en_las, IN[6]=eje_de_vigas_dibujar_en_las, IN[7]=eje_de_vigas_estilo_de_linea, IN[8]=eje_de_vigas_redibujar_los)  # "PY | Ejes visibles + eje de vigas + cadena de cotas"; PythonNet3
# ---------- py_ejes_visibles_eje_de_vigas.python (680 lines) ----------
# 03_Ejes y cotas entre ejes - ACERO
#
# Reemplaza por completo el 03 de fundaciones (cotas de ancho/largo/altura y spot
# elevations sobre Structural Foundation), que no aplica a estructura metalica.
#
# Hace tres cosas:
#   1. Enciende la categoria Grids en las plantas (NIPB y T.A.) y en las elevaciones
#      de eje del assembly, para que los ejes se vean.
#   2. En cada PLANTA que muestre vigas (Structural Framing), dibuja el EJE de cada
#      viga como una detail line roja con el estilo L-CENTER.
#   3. En cada PLANTA, arma la cadena de cotas ENTRE EJES, por fuera del borde del
#      assembly: una cadena horizontal por encima y una vertical a la izquierda.
#
# Solo se acota eje contra eje (no borde-eje-borde): es lo que pide el estandar
# ("cotas asociadas entre ejes") y evita depender de caras de la geometria, que en
# acero son poco fiables como referencia (pernos, planchas, conexiones).
#
# Revit 2027 / Dynamo 4 / CPython3
# IN[0] = procesar todos los assemblies (bool)
# IN[1] = filtro por nombre si IN[0] es False (parcial, comas)
# IN[2] = separacion de la cadena respecto al borde del assembly, en mm de papel
# IN[3] = cadena horizontal, por encima de la planta (bool)
# IN[4] = cadena vertical, a la izquierda de la planta (bool)
# IN[5] = mostrar los ejes tambien en las elevaciones de eje (bool)
# IN[6] = dibujar el eje de cada viga en las plantas (bool)
# IN[7] = nombre del estilo de linea para ese eje (string, ej. L-CENTER)
# IN[8] = redibujar: borra los ejes de viga previos de ese estilo y los rehace (bool)

import clr
clr.AddReference('RevitAPI')
clr.AddReference('RevitServices')
from Autodesk.Revit.DB import (FilteredElementCollector, AssemblyInstance, View,
                               Grid, Line, XYZ, Reference, ReferenceArray, Dimension,
                               Element, ElementId, BuiltInCategory, Options,
                               ViewDetailLevel, Solid, GeometryInstance, FamilyInstance,
                               FailureProcessingResult, FailureSeverity,
                               Color, GraphicsStyleType, CurveElement, LinePatternElement)
from System.Collections.Generic import List
from RevitServices.Persistence import DocumentManager
from RevitServices.Transactions import TransactionManager

doc = DocumentManager.Instance.CurrentDBDocument

process_all = bool(IN[0])
filter_text = (IN[1] or '').strip()
offset_mm = float(IN[2])
chain_h = bool(IN[3])
chain_v = bool(IN[4])
ejes_en_elev = bool(IN[5])
dibujar_eje_viga = bool(IN[6])
estilo_pedido = (IN[7] or '').strip() or 'L-CENTER'
redibujar_eje_viga = bool(IN[8])

log = []

# --- contrato de nombres con 00_Vistas de assembly ---
SUF_NIPB = ' - NIPB'
SUF_TA = ' - T.A. '
SUF_EJE = ' - EJE '

PARALELO = 0.99
TOL_EJE = 0.016    # pies (~5 mm): ejes a menos de esto se consideran el mismo
TOL_LINEA = 0.0033  # pies (~1 mm): por debajo de esto la viga es un punto en planta


def elem_name(e):
    try:
        return e.Name
    except Exception:
        return Element.Name.__get__(e)


def member_solid_bbox(el):
    # bbox a partir de la geometria SOLIDA real (Volume > 0): Element.get_BoundingBox
    # puede devolver un bbox "fantasma" para elementos con geometria degenerada.
    opt = Options()
    opt.DetailLevel = ViewDetailLevel.Fine
    try:
        geo = el.get_Geometry(opt)
    except Exception:
        geo = None
    if geo is None:
        return None
    pts = []

    def puntos(solid, trf):
        sbb = solid.GetBoundingBox()
        for x in (sbb.Min.X, sbb.Max.X):
            for y in (sbb.Min.Y, sbb.Max.Y):
                for z in (sbb.Min.Z, sbb.Max.Z):
                    p = sbb.Transform.OfPoint(XYZ(x, y, z))
                    if trf is not None:
                        p = trf.OfPoint(p)
                    yield p

    for g in geo:
        if isinstance(g, Solid) and g.Volume > 1e-9:
            pts.extend(list(puntos(g, None)))
        elif isinstance(g, GeometryInstance):
            for sg in g.GetSymbolGeometry():
                if isinstance(sg, Solid) and sg.Volume > 1e-9:
                    pts.extend(list(puntos(sg, g.Transform)))
    if not pts:
        return None
    minx = min(p.X for p in pts)
    maxx = max(p.X for p in pts)
    miny = min(p.Y for p in pts)
    maxy = max(p.Y for p in pts)
    minz = min(p.Z for p in pts)
    maxz = max(p.Z for p in pts)

    class _BB(object):
        pass
    r = _BB()
    r.Min = XYZ(minx, miny, minz)
    r.Max = XYZ(maxx, maxy, maxz)
    return r


def miembros_recursivos(ai):
    # todos los elementos del assembly, incluidas las familias anidadas a cualquier
    # profundidad. Se usa para el bbox y para saber que vigas son "de este assembly".
    res = []
    pila = [doc.GetElement(mid) for mid in ai.GetMemberIds()]
    vistos = set()
    while pila:
        el = pila.pop()
        if el is None:
            continue
        try:
            eid = el.Id.Value
        except Exception:
            eid = None
        if eid is not None:
            if eid in vistos:
                continue
            vistos.add(eid)
        res.append(el)
        if isinstance(el, FamilyInstance):
            try:
                for sid in el.GetSubComponentIds():
                    pila.append(doc.GetElement(sid))
            except Exception:
                pass
    return res


def bbox_assembly(miembros):
    # bbox de mundo del assembly a partir de sus miembros recursivos
    pts = []
    for el in miembros:
        bb = member_solid_bbox(el)
        if bb is not None:
            pts.append(bb.Min)
            pts.append(bb.Max)
    if not pts:
        return None

    class _BB(object):
        pass
    r = _BB()
    r.Min = XYZ(min(p.X for p in pts), min(p.Y for p in pts), min(p.Z for p in pts))
    r.Max = XYZ(max(p.X for p in pts), max(p.Y for p in pts), max(p.Z for p in pts))
    return r


def segmento_cruza_rect(p0, p1, xmin, ymin, xmax, ymax):
    # recorte Liang-Barsky del SEGMENTO contra el rectangulo en planta - mismo test
    # que usa 00 para decidir que ejes merecen elevacion, para que ambos graphs
    # trabajen sobre el MISMO conjunto de ejes.
    dx = p1.X - p0.X
    dy = p1.Y - p0.Y
    t0 = 0.0
    t1 = 1.0
    for pc, q in ((-dx, p0.X - xmin), (dx, xmax - p0.X),
                  (-dy, p0.Y - ymin), (dy, ymax - p0.Y)):
        if abs(pc) < 1e-12:
            if q < 0:
                return False
        else:
            r = q / pc
            if pc < 0:
                if r > t1:
                    return False
                if r > t0:
                    t0 = r
            else:
                if r < t0:
                    return False
                if r < t1:
                    t1 = r
    return True


def ejes_que_cruzan(bb, tname):
    res = []
    for g in FilteredElementCollector(doc).OfClass(Grid):
        try:
            c = g.Curve
        except Exception:
            continue
        if c is None or not isinstance(c, Line):
            continue
        if segmento_cruza_rect(c.GetEndPoint(0), c.GetEndPoint(1),
                               bb.Min.X, bb.Min.Y, bb.Max.X, bb.Max.Y):
            res.append(g)
    return res


ID_CAT_GRIDS = ElementId(BuiltInCategory.OST_Grids)
ID_CAT_LINES = ElementId(BuiltInCategory.OST_Lines)


def mostrar_ejes(v, tname, label):
    # enciende la categoria Grids en la vista. En las elevaciones de eje, 00 ya
    # incluyo los ejes en el aislamiento permanente; sin eso, encender la categoria
    # no bastaria porque el elemento quedaria oculto uno por uno.
    try:
        if v.GetCategoryHidden(ID_CAT_GRIDS):
            if v.CanCategoryBeHidden(ID_CAT_GRIDS):
                v.SetCategoryHidden(ID_CAT_GRIDS, False)
                return True
    except Exception as e:
        log.append('AVISO {}: no se pudo encender la categoria Grids en {}: {}'.format(tname, label, e))
    return False


# ------------------------------------------------- eje de vigas en planta

_estilo_cache = {}


def patron_de_eje():
    # patron de linea de eje ya cargado en el proyecto; si no hay ninguno, solida.
    for lp in FilteredElementCollector(doc).OfClass(LinePatternElement):
        try:
            n = elem_name(lp).lower()
        except Exception:
            continue
        if 'center' in n or 'centro' in n or n.startswith('eje'):
            return lp.Id
    return None


def estilo_linea(nombre):
    # GraphicsStyle de la subcategoria de Lines con ese nombre. Si no existe se crea
    # roja y con patron de eje, para que el graph tambien funcione en un modelo que
    # todavia no tiene cargado el estandar. Si ya existe NO se toca: el grafismo de
    # L-CENTER es del proyecto, no de este script.
    if nombre in _estilo_cache:
        return _estilo_cache[nombre]
    gs = None
    try:
        cat = doc.Settings.Categories.get_Item(BuiltInCategory.OST_Lines)
        sub = None
        for c in cat.SubCategories:
            if c.Name.strip().lower() == nombre.strip().lower():
                sub = c
                break
        if sub is None:
            sub = doc.Settings.Categories.NewSubcategory(cat, nombre)
            sub.LineColor = Color(255, 0, 0)
            pid = patron_de_eje()
            if pid is not None:
                sub.SetLinePatternId(pid, GraphicsStyleType.Projection)
            doc.Regenerate()
            log.append('Estilo de linea "{}": no existia, se creo rojo{}.'.format(
                nombre, '' if pid is None else ' con patron de eje'))
        else:
            try:
                col = sub.LineColor
                log.append('Estilo de linea "{}": ya existe, RGB {},{},{} (se usa tal cual).'.format(
                    nombre, col.Red, col.Green, col.Blue))
            except Exception:
                log.append('Estilo de linea "{}": ya existe (se usa tal cual).'.format(nombre))
        gs = sub.GetGraphicsStyle(GraphicsStyleType.Projection)
        if gs is None:
            log.append('ERROR: el estilo de linea "{}" no tiene GraphicsStyle de proyeccion.'.format(nombre))
    except Exception as e:
        log.append('ERROR: no se pudo resolver el estilo de linea "{}": {}'.format(nombre, e))
    _estilo_cache[nombre] = gs
    return gs


def planos_candidatos(view):
    # cotas donde puede vivir una detail line de esta planta. Una planta es
    # horizontal, asi que "proyectar al plano de la vista" es fijar la Z. Lo normal
    # es view.Origin.Z; el nivel de la vista es el plan B por si Origin no cayera en
    # el plano de trabajo (Revit rechaza la curva: "must be in the plane of the view").
    zs = [view.Origin.Z]
    try:
        lv = view.GenLevel
        if lv is not None and abs(lv.ProjectElevation - zs[0]) > 1e-9:
            zs.append(lv.ProjectElevation)
    except Exception:
        pass
    return zs


def lineas_previas(view, gs_id):
    prev = []
    for e in (FilteredElementCollector(doc, view.Id)
              .OfCategory(BuiltInCategory.OST_Lines)
              .WhereElementIsNotElementType()):
        try:
            if isinstance(e, CurveElement) and e.LineStyle is not None and e.LineStyle.Id == gs_id:
                prev.append(e.Id)
        except Exception:
            pass
    return prev


def ejes_de_viga(view, gs, ids_miembros, tname, label):
    # dibuja el eje (curva de ubicacion) de cada viga VISIBLE en la planta, como
    # detail line: es especifica de la vista, asi que cada planta muestra solo los
    # ejes de las vigas de SU nivel y el modelo no se ensucia con lineas de modelo.
    if gs is None:
        return 0
    prev = lineas_previas(view, gs.Id)
    if prev:
        if not redibujar_eje_viga:
            log.append('{}: {} ya tiene {} linea(s) de eje de viga, se salta.'.format(
                tname, label, len(prev)))
            return 0
        try:
            doc.Delete(List[ElementId](prev))
        except Exception as e:
            log.append('AVISO {}: no se pudieron borrar los ejes previos de {}: {}'.format(tname, label, e))
    try:
        # el colector por vista respeta el View Range y el aislamiento, asi que
        # devuelve exactamente las vigas del nivel que esa planta documenta.
        vigas = [e for e in (FilteredElementCollector(doc, view.Id)
                             .OfCategory(BuiltInCategory.OST_StructuralFraming)
                             .WhereElementIsNotElementType())
                 if e.Id.Value in ids_miembros]
    except Exception as e:
        log.append('ERROR {}: no se pudieron listar las vigas de {}: {}'.format(tname, label, e))
        return 0
    if not vigas:
        log.append('{}: {} no muestra vigas del assembly; sin ejes que dibujar.'.format(tname, label))
        return 0
    # las detail lines viven en la categoria Lines: si el template la apaga, no se ven
    try:
        if view.GetCategoryHidden(ID_CAT_LINES) and view.CanCategoryBeHidden(ID_CAT_LINES):
            view.SetCategoryHidden(ID_CAT_LINES, False)
    except Exception as e:
        log.append('AVISO {}: no se pudo encender la categoria Lines en {}: {}'.format(tname, label, e))
    zs = planos_candidatos(view)
    z_ok = zs[0]
    z_fijo = False       # en cuanto una detail line entra, esa cota es LA cota
    ultimo_error = None
    hechas = 0
    sin_curva = 0
    verticales = 0
    fallidas = 0
    for el in vigas:
        c = None
        try:
            loc = el.Location
            if loc is not None and hasattr(loc, 'Curve'):
                c = loc.Curve
        except Exception:
            c = None
        if c is None:
            sin_curva += 1
            continue
        try:
            if isinstance(c, Line):
                pts = [c.GetEndPoint(0), c.GetEndPoint(1)]
            else:
                pts = list(c.Tessellate())   # viga curva: poligonal en planta
        except Exception:
            sin_curva += 1
            continue
        # aplanados a Z=0 solo para medir el largo EN PLANTA (la Z real la pone el
        # plano de la vista, mas abajo)
        pares = [(XYZ(a.X, a.Y, 0.0), XYZ(b.X, b.Y, 0.0)) for a, b in zip(pts[:-1], pts[1:])]
        segs = [(a, b) for a, b in pares if a.DistanceTo(b) >= TOL_LINEA]
        if not segs:
            verticales += 1   # riostra o pilarcillo vertical: en planta el eje es un punto
            continue
        for a, b in segs:
            hecha = False
            for z in ([z_ok] if z_fijo else zs):
                try:
                    dc = doc.Create.NewDetailCurve(
                        view, Line.CreateBound(XYZ(a.X, a.Y, z), XYZ(b.X, b.Y, z)))
                    dc.LineStyle = gs
                    hechas += 1
                    hecha = True
                    if not z_fijo:
                        if z != zs[0]:
                            log.append('AVISO {}: en {} las detail lines van a EL. {:.3f} pies; view.Origin no servia.'.format(
                                tname, label, z))
                        z_ok = z
                        z_fijo = True
                    break
                except Exception as e:
                    ultimo_error = e
            if not hecha:
                fallidas += 1
                if fallidas == 1:
                    log.append('ERROR {}: no se pudo dibujar el eje de una viga en {}: {}'.format(
                        tname, label, ultimo_error))
    detalles = []
    if sin_curva:
        detalles.append('{} sin curva de ubicacion'.format(sin_curva))
    if verticales:
        detalles.append('{} verticales'.format(verticales))
    if fallidas:
        detalles.append('{} fallidas'.format(fallidas))
    log.append('OK {}: {} linea(s) de eje en {} sobre {} viga(s){}.'.format(
        tname, hechas, label, len(vigas),
        '' if not detalles else ' [' + ', '.join(detalles) + ']'))
    return hechas


def tiene_cadena(v):
    # ya existe una cota de mas de un segmento -> este graph ya corrio en esta vista
    for dim in FilteredElementCollector(doc, v.Id).OfClass(Dimension):
        try:
            if dim.NumberOfSegments > 1:
                return True
        except Exception:
            pass
    return False


def punto_en_vista(rd, ud, a, b, z):
    # reconstruye el punto de mundo cuya proyeccion sobre rd vale a y sobre ud vale b.
    # rd y ud de una planta son horizontales y ortogonales, asi que generan el plano XY.
    vv = rd.Multiply(a).Add(ud.Multiply(b))
    return XYZ(vv.X, vv.Y, z)


def cadena_de_ejes(view, grids, d_medida, horizontal, valor_perp, tname, etiqueta):
    # cadena de cotas eje-a-eje: los ejes se ordenan por su posicion a lo largo de
    # d_medida y la linea de cota se dibuja a "valor_perp" sobre el eje perpendicular
    # (ya desplazado por fuera del borde del assembly).
    items = []
    for g in grids:
        c = g.Curve
        medio = c.Evaluate(0.5, True)
        pos = medio.DotProduct(d_medida)
        try:
            ref = Reference(g)
        except Exception:
            continue
        items.append((pos, ref, elem_name(g)))
    if len(items) < 2:
        log.append('AVISO {}: menos de 2 ejes para la cadena {}; no se acota.'.format(tname, etiqueta))
        return 0
    items.sort(key=lambda it: it[0])
    filtrados = []
    ultimo = None
    for pos, ref, nombre in items:
        if ultimo is None or pos - ultimo > TOL_EJE:
            filtrados.append((pos, ref, nombre))
            ultimo = pos
    if len(filtrados) < 2:
        log.append('AVISO {}: los ejes de la cadena {} estan superpuestos; no se acota.'.format(tname, etiqueta))
        return 0
    ra = ReferenceArray()
    for pos, ref, nombre in filtrados:
        ra.Append(ref)
    z = view.Origin.Z
    rd = view.RightDirection
    ud = view.UpDirection
    if horizontal:
        # la cadena corre a lo ancho (rd) y se dibuja a la altura valor_perp (ud)
        p1 = punto_en_vista(rd, ud, filtrados[0][0], valor_perp, z)
        p2 = punto_en_vista(rd, ud, filtrados[-1][0], valor_perp, z)
    else:
        p1 = punto_en_vista(rd, ud, valor_perp, filtrados[0][0], z)
        p2 = punto_en_vista(rd, ud, valor_perp, filtrados[-1][0], z)
    if p1.DistanceTo(p2) < 1e-6:
        log.append('AVISO {}: la cadena {} quedaria de largo cero.'.format(tname, etiqueta))
        return 0
    dim = doc.Create.NewDimension(view, Line.CreateBound(p1, p2), ra)
    creadas.append((tname, etiqueta, dim.Id))
    log.append('OK {}: cadena {} con {} ejes ({}).'.format(
        tname, etiqueta, len(filtrados), ', '.join(n for _, _, n in filtrados)))
    return 1


# ------------------------------------------------------------------ main

by_type = {}
for ai in FilteredElementCollector(doc).OfClass(AssemblyInstance):
    by_type.setdefault(ai.AssemblyTypeName, []).append(ai)

if not by_type:
    log.append('AVISO: no hay ningun Assembly en el modelo; nada que anotar.')

if process_all:
    targets = sorted(by_type.keys())
else:
    tokens = [t.strip().lower() for t in filter_text.split(',') if t.strip()]
    if tokens:
        targets = [n for n in sorted(by_type.keys())
                   if any(tok in n.lower() for tok in tokens)]
    else:
        targets = []
        log.append('ERROR: "Todos" esta en False y el filtro esta vacio.')

views = {}
for v in FilteredElementCollector(doc).OfClass(View):
    if not v.IsTemplate:
        views[elem_name(v)] = v

total = 0
encendidas = 0
lineas_eje = 0
creadas = []   # (assembly, etiqueta, id) para verificar tras el commit


def _resolver_fallas(sender, args):
    # al confirmar la transaccion, elimina automaticamente las cotas que Revit
    # rechaza por referencias invalidas, en vez de mostrar el dialogo bloqueante
    try:
        fa = args.GetFailuresAccessor()
        resultado = FailureProcessingResult.Continue
        for f in fa.GetFailureMessages():
            try:
                if f.GetSeverity() == FailureSeverity.Warning:
                    fa.DeleteWarning(f)
                    continue
                ids = list(f.GetFailingElementIds())
                if ids:
                    fa.DeleteElements(List[ElementId](ids))
                    resultado = FailureProcessingResult.ProceedWithCommit
                elif f.HasResolutions():
                    fa.ResolveFailure(f)
                    resultado = FailureProcessingResult.ProceedWithCommit
            except Exception:
                pass
        args.SetProcessingResult(resultado)
    except Exception:
        pass


app = doc.Application
app.FailuresProcessing += _resolver_fallas
TransactionManager.Instance.EnsureInTransaction(doc)
try:
    gs_eje = estilo_linea(estilo_pedido) if (dibujar_eje_viga and targets) else None
    for tname in targets:
        ai = by_type[tname][0]
        try:
            miembros = miembros_recursivos(ai)
            ids_miembros = set()
            for el in miembros:
                try:
                    ids_miembros.add(el.Id.Value)
                except Exception:
                    pass
            bb = bbox_assembly(miembros)
            if bb is None:
                log.append('ERROR {}: sin geometria solida valida; se omite.'.format(tname))
                continue
            ejes = ejes_que_cruzan(bb, tname)

            plantas = []
            v = views.get(tname + SUF_NIPB)
            if v is not None:
                plantas.append((v, 'planta NIPB'))
            for n in sorted(k for k in views if k.startswith(tname + SUF_TA)):
                plantas.append((views[n], n[len(tname) + 3:]))
            elevaciones = [(views[n], n[len(tname) + 3:])
                           for n in sorted(k for k in views if k.startswith(tname + SUF_EJE))]

            if not plantas:
                log.append('AVISO {}: no existen las plantas (corre 00_Vistas de assembly).'.format(tname))
                continue

            # --- 1. ejes visibles ---
            for v, label in plantas:
                if mostrar_ejes(v, tname, label):
                    encendidas += 1
            if ejes_en_elev:
                for v, label in elevaciones:
                    if mostrar_ejes(v, tname, label):
                        encendidas += 1

            # --- 2. eje de las vigas, SOLO en las plantas ---
            if dibujar_eje_viga:
                for v, label in plantas:
                    try:
                        lineas_eje += ejes_de_viga(v, gs_eje, ids_miembros, tname, label)
                    except Exception as e:
                        log.append('ERROR {} eje de vigas en {}: {}'.format(tname, label, e))

            if not ejes:
                log.append('AVISO {}: ningun eje cruza el assembly; no hay nada que acotar.'.format(tname))
                continue

            # --- 3. cadenas de cotas entre ejes, en cada planta ---
            for v, label in plantas:
                if tiene_cadena(v):
                    log.append('{}: {} ya tiene cadena de cotas, se salta.'.format(tname, label))
                    continue
                rd = v.RightDirection
                ud = v.UpDirection
                off = offset_mm / 304.8 * (v.Scale if v.Scale > 0 else 1)

                # extension del assembly proyectada sobre los ejes de la vista
                rs = []
                us = []
                for x in (bb.Min.X, bb.Max.X):
                    for y in (bb.Min.Y, bb.Max.Y):
                        for z in (bb.Min.Z, bb.Max.Z):
                            p = XYZ(x, y, z)
                            rs.append(p.DotProduct(rd))
                            us.append(p.DotProduct(ud))
                r0, r1 = min(rs), max(rs)
                u0, u1 = min(us), max(us)

                # un eje paralelo a "arriba" de la vista se mide a lo largo de
                # "derecha", y su cadena va por encima del assembly; y viceversa.
                g_para_h = []
                g_para_v = []
                oblicuos = []
                for g in ejes:
                    c = g.Curve
                    d = c.GetEndPoint(1) - c.GetEndPoint(0)
                    d = XYZ(d.X, d.Y, 0.0)
                    if d.GetLength() < 1e-9:
                        continue
                    d = d.Normalize()
                    if abs(d.DotProduct(ud)) > PARALELO:
                        g_para_h.append(g)
                    elif abs(d.DotProduct(rd)) > PARALELO:
                        g_para_v.append(g)
                    else:
                        oblicuos.append(elem_name(g))
                if oblicuos:
                    log.append('AVISO {}: ejes oblicuos a la vista, fuera de la cadena: {}.'.format(
                        tname, ', '.join(sorted(oblicuos))))

                if chain_h:
                    try:
                        total += cadena_de_ejes(v, g_para_h, rd, True, u1 + off,
                                                tname, '{} horizontal'.format(label))
                    except Exception as e:
                        log.append('ERROR {} cadena horizontal en {}: {}'.format(tname, label, e))
                if chain_v:
                    try:
                        total += cadena_de_ejes(v, g_para_v, ud, False, r0 - off,
                                                tname, '{} vertical'.format(label))
                    except Exception as e:
                        log.append('ERROR {} cadena vertical en {}: {}'.format(tname, label, e))
        except Exception as e:
            log.append('ERROR {}: {}'.format(tname, e))
finally:
    try:
        TransactionManager.Instance.TransactionTaskDone()
        # Dynamo confirma su transaccion al final del run, cuando este script ya
        # termino y el manejador de fallas se des-suscribio. Forzamos el commit
        # AQUI para que el manejador intercepte las referencias invalidas.
        TransactionManager.Instance.ForceCloseTransaction()
    finally:
        app.FailuresProcessing -= _resolver_fallas

# verificar cuales cadenas sobrevivieron al commit
descartadas = []
for tname_c, etiqueta_c, did in creadas:
    try:
        if doc.GetElement(did) is None:
            descartadas.append('{} ({})'.format(tname_c, etiqueta_c))
    except Exception:
        pass
if descartadas:
    total -= len(descartadas)
    log.append('AVISO: cadenas eliminadas por referencias invalidas: ' + ', '.join(descartadas))
    log.append('Causa habitual: el eje no es visible en esa vista (Revit no acota lo que no ve).')
    log.append('Revisa que la categoria Grids este encendida y que el eje entre en el crop de la vista.')

log.insert(0, 'Cadenas creadas: {} | lineas de eje de viga: {} | vistas con Grids encendido: {} | assemblies procesados: {}'.format(
    total, lineas_eje, encendidas, len(targets)))
OUT = log
# ----------------------------------------
log = Watch(py_ejes_visibles_eje_de_vigas)  # graph output
